# Grasshopper definition housing.gh (Grasshopper 0.9.76)

height = Slider(25, range=20..50)
length = Slider(55.2, range=25..75)
width = Slider(60, range=25..75)

division = Division(A=height, B=2)
division_2 = Division(A=length, B=2)
division_3 = Division(A=width, B=2)
main_radius = Slider(5, range=0..10)
construct_point = ConstructPoint(XCoordinate=expr("-x", division_2), YCoordinate=expr("-x", division_3), ZCoordinate=expr("-x", division))
construct_point_2 = ConstructPoint(XCoordinate=division_2, YCoordinate=division_3, ZCoordinate=division)
xz_plane = XZPlane(Origin=Point(0, 0, 0))
yz_plane = YZPlane(Origin=Point(0, 0, 0))
xy_plane = XYPlane(Origin=Point(0, 0, 0))
subtraction = Subtraction(A=division_3, B=main_radius)
subtraction_2 = Subtraction(A=division_2, B=main_radius)
subtraction_3 = Subtraction(A=division, B=main_radius)
plane_offset = PlaneOffset(BasePlane=xy_plane, Offset=expr("-x", subtraction_3))
plane_offset_2 = PlaneOffset(BasePlane=xz_plane, Offset=expr("-x", subtraction))
plane_offset_3 = PlaneOffset(BasePlane=xy_plane, Offset=subtraction_3)
plane_offset_4 = PlaneOffset(BasePlane=xz_plane, Offset=subtraction)
plane_offset_5 = PlaneOffset(BasePlane=yz_plane, Offset=expr("-x", subtraction_2))
plane_offset_6 = PlaneOffset(BasePlane=yz_plane, Offset=subtraction_2)
construct_point_3 = ConstructPoint(XCoordinate=expr("-x", subtraction_2), YCoordinate=expr("-x", subtraction), ZCoordinate=expr("-x", subtraction_3))
construct_point_4 = ConstructPoint(XCoordinate=subtraction_2, YCoordinate=subtraction, ZCoordinate=subtraction_3)
rectangle_2pt = Rectangle2Pt(Plane=plane_offset_3, PointA=construct_point_2, PointB=construct_point, Radius=main_radius)  # -> Rectangle, Length
rectangle_2pt_2 = Rectangle2Pt(Plane=plane_offset_4, PointA=construct_point_2, PointB=construct_point, Radius=main_radius)  # -> Rectangle, Length
rectangle_2pt_3 = Rectangle2Pt(Plane=plane_offset, PointA=construct_point_2, PointB=construct_point, Radius=main_radius)  # -> Rectangle, Length
rectangle_2pt_4 = Rectangle2Pt(Plane=plane_offset_2, PointA=construct_point_2, PointB=construct_point, Radius=main_radius)  # -> Rectangle, Length
rectangle_2pt_5 = Rectangle2Pt(Plane=plane_offset_6, PointA=construct_point_2, PointB=construct_point, Radius=main_radius)  # -> Rectangle, Length
rectangle_2pt_6 = Rectangle2Pt(Plane=plane_offset_5, PointA=construct_point_2, PointB=construct_point, Radius=main_radius)  # -> Rectangle, Length
mirror = Mirror(Geometry=construct_point_4, Plane=yz_plane)  # -> Geometry, Transform
mirror_2 = Mirror(Geometry=construct_point_3, Plane=yz_plane)  # -> Geometry, Transform
loft = Loft(
    Curves=[rectangle_2pt.Rectangle, rectangle_2pt_3.Rectangle],
    Options={Adjust=False, Closed=False, LoftEnds=0, LoftSimp=0, LoftType=0, Rebuild=10, Refit=0.01})
loft_2 = Loft(
    Curves=[rectangle_2pt_2.Rectangle, rectangle_2pt_4.Rectangle],
    Options={Adjust=False, Closed=False, LoftEnds=0, LoftSimp=0, LoftType=0, Rebuild=10, Refit=0.01})
loft_3 = Loft(
    Curves=[rectangle_2pt_5.Rectangle, rectangle_2pt_6.Rectangle],
    Options={Adjust=False, Closed=False, LoftEnds=0, LoftSimp=0, LoftType=0, Rebuild=10, Refit=0.01})
mirror_3 = Mirror(Geometry=[mirror.Geometry, construct_point_4], Plane=xz_plane)  # -> Geometry, Transform
mirror_4 = Mirror(Geometry=[mirror_2.Geometry, construct_point_3], Plane=xz_plane)  # -> Geometry, Transform
cap_holes = CapHoles(Brep=loft)
cap_holes_2 = CapHoles(Brep=loft_2)
cap_holes_3 = CapHoles(Brep=loft_3)
sphere = Sphere(Base=[mirror_3.Geometry, construct_point_4, mirror.Geometry], Radius=main_radius)
sphere_2 = Sphere(Base=[mirror_4.Geometry, mirror_2.Geometry, construct_point_3], Radius=main_radius)
solid_union = SolidUnion(Breps=[cap_holes_2, cap_holes, cap_holes_3, sphere, sphere_2])

gap = Slider(0.1, range=0..1)
xy_plane_2 = XYPlane(Origin=Point(0, 0, 0))
division_4 = Division(A=gap, B=2)
plane_offset_7 = PlaneOffset(BasePlane=xy_plane_2, Offset=expr("-x", division))
plane_offset_8 = PlaneOffset(BasePlane=xy_plane_2, Offset=division_4)
plane_offset_9 = PlaneOffset(BasePlane=xy_plane_2, Offset=expr("-x", division_4))
plane_offset_10 = PlaneOffset(BasePlane=xy_plane_2, Offset=division)
rectangle_2pt_7 = Rectangle2Pt(Plane=plane_offset_8, PointA=construct_point_2, PointB=construct_point, Radius=0)  # -> Rectangle, Length
rectangle_2pt_8 = Rectangle2Pt(Plane=plane_offset_9, PointA=construct_point_2, PointB=construct_point, Radius=0)  # -> Rectangle, Length
rectangle_2pt_9 = Rectangle2Pt(Plane=plane_offset_10, PointA=construct_point_2, PointB=construct_point, Radius=0)  # -> Rectangle, Length
rectangle_2pt_10 = Rectangle2Pt(Plane=plane_offset_7, PointA=construct_point_2, PointB=construct_point, Radius=0)  # -> Rectangle, Length
loft_4 = Loft(
    Curves=[rectangle_2pt_9.Rectangle, rectangle_2pt_8.Rectangle],
    Options={Adjust=False, Closed=False, LoftEnds=0, LoftSimp=0, LoftType=0, Rebuild=10, Refit=0.01})
loft_5 = Loft(
    Curves=[rectangle_2pt_7.Rectangle, rectangle_2pt_10.Rectangle],
    Options={Adjust=False, Closed=False, LoftEnds=0, LoftSimp=0, LoftType=0, Rebuild=10, Refit=0.01})
cap_holes_4 = CapHoles(Brep=loft_4)
cap_holes_5 = CapHoles(Brep=loft_5)
solid_difference = SolidDifference(BrepsA=solid_union, BrepsB=cap_holes_4)
solid_difference_2 = SolidDifference(BrepsA=solid_union, BrepsB=cap_holes_5)

wall_thickness = Slider(1.5, range=1..3)
deconstruct_brep = DeconstructBrep(Brep=solid_union)  # -> Faces, Edges, Vertices
flatten_tree = FlattenTree(Tree=deconstruct_brep.Faces, Path="{0}")
offset = Offset(Surface=flatten_tree, Distance=expr("-x", wall_thickness), Retrim=True)
brep_join = BrepJoin(Breps=offset)  # -> Breps, Closed

division_5 = Division(A=Slider(5, range=0..10), B=2)
vector_xyz = VectorXYZ(XComponent=expr("-x", division_5), YComponent=expr("-x", division_5), ZComponent=0)  # -> Vector, Length
vector_xyz_2 = VectorXYZ(XComponent=division_5, YComponent=division_5, ZComponent=0)  # -> Vector, Length
xy_plane_3 = XYPlane(Origin=Point(0, 0, 0))
plane_offset_11 = PlaneOffset(BasePlane=xy_plane_3, Offset=expr("-x", division))

# ---- group: Raspberry Pi
construct_point_5 = ConstructPoint(XCoordinate=Slider(-0.5, range=-5..5), YCoordinate=Slider(0, range=-5..5), ZCoordinate=Slider(-3.5, range=-10..0))
xy_plane_4 = XYPlane(Origin=Point(0, 0, 0))
yz_plane_2 = YZPlane(Origin=Point(0, 0, 0))
xz_plane_2 = XZPlane(Origin=Point(0, 0, 0))
plane_origin = PlaneOrigin(Base=xz_plane_2, Origin=construct_point_5)
plane_origin_2 = PlaneOrigin(Base=yz_plane_2, Origin=construct_point_5)
plane_origin_3 = PlaneOrigin(Base=xy_plane_4, Origin=construct_point_5)
number_slider = Slider(1, range=0..1)
division_6 = Division(A=Slider(51.2, range=0..100), B=2)
division_7 = Division(A=Slider(21, range=0..100), B=2)
division_8 = Division(A=number_slider, B=2)
vector_xyz_3 = VectorXYZ(XComponent=division_6, YComponent=division_7, ZComponent=division_8)  # -> Vector, Length
reverse = Reverse(Vector=vector_xyz_3.Vector)
move = Move(Geometry=construct_point_5, Motion=vector_xyz_3.Vector)  # -> Geometry, Transform
move_2 = Move(Geometry=construct_point_5, Motion=reverse)  # -> Geometry, Transform
box_2pt = Box2Pt(PointA=move.Geometry, PointB=move_2.Geometry, Plane=plane_origin_3)

# ---- group: Raspberry
vector_xyz_4 = VectorXYZ(XComponent=expr("-x", Slider(2, range=0..5)), YComponent=expr("-x", Slider(3.8, range=0..5)), ZComponent=0)  # -> Vector, Length
move_3 = Move(Geometry=move.Geometry, Motion=vector_xyz_4.Vector)  # -> Geometry, Transform
mirror_5 = Mirror(Geometry=move_3.Geometry, Plane=plane_origin)  # -> Geometry, Transform
merge = Merge(Data1=move_3.Geometry, Data2=mirror_5.Geometry)
mirror_6 = Mirror(Geometry=merge, Plane=plane_origin_2)  # -> Geometry, Transform
number_slider_2 = Slider(1, range=0..4)
merge_2 = Merge(Data1=mirror_6.Geometry, Data2=merge)
cylinder = Cylinder(Base=merge_2, Radius=number_slider_2, Length=expr("-x", number_slider))
cap_holes_6 = CapHoles(Brep=cylinder)

# ---- group: Raspberry Pi (continued)
solid_difference_3 = SolidDifference(BrepsA=box_2pt, BrepsB=cap_holes_6)

# ----
number_slider_3 = Slider(0.5, range=0..1)
addition = Addition(A=division_8, B=number_slider_3)
plane_offset_12 = PlaneOffset(BasePlane=plane_origin_3, Offset=expr("-x", addition))
rectangle_2pt_11 = Rectangle2Pt(Plane=plane_offset_12, PointA=move.Geometry, PointB=move_2.Geometry, Radius=0)  # -> Rectangle, Length
offset_2 = Offset(Curve=rectangle_2pt_11.Rectangle, Distance=number_slider_3, Plane=plane_offset_12, Corners=1)
xy_plane_5 = XYPlane(Origin=Point(0, 0, 0))
flatten_tree_2 = FlattenTree(Tree=offset_2, Path="{0}")
project = Project(Geometry=flatten_tree_2, Plane=xy_plane_5)  # -> Geometry, Transform
loft_6 = Loft(
    Curves=[project.Geometry, flatten_tree_2],
    Options={Adjust=False, Closed=False, LoftEnds=0, LoftSimp=0, LoftType=0, Rebuild=10, Refit=0.01})
cap_holes_7 = CapHoles(Brep=loft_6)

number_slider_4 = Slider(3.9, range=0..10)
subtraction_4 = Subtraction(A=division_2, B=main_radius)
vector_xyz_5 = VectorXYZ(
    XComponent=expr("-x", subtraction_4),
    YComponent=Slider(2.6, range=0..10),
    ZComponent=expr("-x", Slider(0.4, range=0..1)))  # -> Vector, Length
vector_xyz_6 = VectorXYZ(XComponent=expr("-x", subtraction_4), YComponent=number_slider_4, ZComponent=expr("-x", Slider(1, range=0..1)))  # -> Vector, Length
vector_xyz_7 = VectorXYZ(XComponent=expr("-x", subtraction_4), YComponent=number_slider_4, ZComponent=expr("-x", Slider(3, range=0..10)))  # -> Vector, Length
move_4 = Move(Geometry=construct_point_5, Motion=vector_xyz_5.Vector)  # -> Geometry, Transform
move_5 = Move(Geometry=construct_point_5, Motion=vector_xyz_6.Vector)  # -> Geometry, Transform
move_6 = Move(Geometry=construct_point_5, Motion=vector_xyz_7.Vector)  # -> Geometry, Transform
mirror_7 = Mirror(Geometry=move_5.Geometry, Plane=plane_origin)  # -> Geometry, Transform
mirror_8 = Mirror(Geometry=move_6.Geometry, Plane=plane_origin)  # -> Geometry, Transform
mirror_9 = Mirror(Geometry=move_4.Geometry, Plane=plane_origin)  # -> Geometry, Transform
merge_3 = Merge(
    Data1=move_4.Geometry,
    Data2=move_5.Geometry,
    Data3=move_6.Geometry,
    Data4=mirror_8.Geometry,
    Data5=mirror_7.Geometry,
    Data6=mirror_9.Geometry)
shift_list = ShiftList(List=merge_3, Shift=1, Wrap=True)
line = Line(StartPoint=merge_3, EndPoint=shift_list)
divide_length = DivideLength(Curve=line, Length=Slider(0.4, range=0..1))  # -> Points, Tangents, Parameters
list_item = ListItem(List=divide_length.Points, Index=1, Wrap=False)
list_item_2 = ListItem(List=divide_length.Points, Index=-1, Wrap=True)
subtraction_5 = Subtraction(A=division_2, B=wall_thickness)
flatten_tree_3 = FlattenTree(Tree=[list_item, list_item_2], Path="{0}")
yz_plane_3 = YZPlane(Origin=Point(0, 0, 0))
addition_2 = Addition(A=division_2, B=Slider(2, range=0..10))
yz_plane_4 = YZPlane(Origin=Point(0, 0, 0))
addition_3 = Addition(A=subtraction_5, B=number_slider_3)
nurbs_curve = NurbsCurve(Vertices=flatten_tree_3, Degree=2, Periodic=True)  # -> Curve, Length, Domain
plane_offset_13 = PlaneOffset(BasePlane=yz_plane_3, Offset=expr("-x", addition_2))
plane_offset_14 = PlaneOffset(BasePlane=yz_plane_4, Offset=expr("-x", addition_3))
offset_3 = Offset(Curve=nurbs_curve.Curve, Distance=Slider(0.3, range=0..1), Plane=PlaneXY(0, 0, 0), Corners=1)
project_2 = Project(Geometry=nurbs_curve.Curve, Plane=plane_offset_13)  # -> Geometry, Transform
flatten_tree_4 = FlattenTree(Tree=offset_3, Path="{0}")
project_3 = Project(Geometry=flatten_tree_4, Plane=plane_offset_14)  # -> Geometry, Transform
loft_7 = Loft(
    Curves=[nurbs_curve.Curve, project_2.Geometry],
    Options={Adjust=False, Closed=False, LoftEnds=0, LoftSimp=0, LoftType=0, Rebuild=10, Refit=0.01})
cap_holes_8 = CapHoles(Brep=loft_7)
loft_8 = Loft(
    Curves=[project_3.Geometry, flatten_tree_4],
    Options={Adjust=False, Closed=False, LoftEnds=0, LoftSimp=0, LoftType=0, Rebuild=10, Refit=0.01})
cap_holes_9 = CapHoles(Brep=loft_8)
solid_union_2 = SolidUnion(Breps=[cap_holes_8, cap_holes_9])

xy_plane_6 = XYPlane(Origin=Point(0, 0, 0))
plane_offset_15 = PlaneOffset(BasePlane=xy_plane_6, Offset=number_slider_3)
project_4 = Project(Geometry=move_3.Geometry, Plane=plane_offset_15)  # -> Geometry, Transform
yz_plane_5 = YZPlane(Origin=Point(0, 0, 0))
plane_offset_16 = PlaneOffset(BasePlane=yz_plane_5, Offset=division_2)
xy_plane_7 = XYPlane(Origin=Point(0, 0, 0))
project_5 = Project(Geometry=project_4.Geometry, Plane=plane_offset_16)  # -> Geometry, Transform
plane_offset_17 = PlaneOffset(BasePlane=xy_plane_7, Offset=division)
merge_4 = Merge(Data1=project_4.Geometry, Data2=project_5.Geometry)
project_6 = Project(Geometry=merge_4, Plane=plane_offset_17)  # -> Geometry, Transform
reverse_list = ReverseList(List=project_6.Geometry)
merge_5 = Merge(Data1=merge_4, Data2=reverse_list)
polyline = PolyLine(Vertices=merge_5, Closed=True)

project_7 = Project(Geometry=move_3.Geometry, Plane=plane_offset_12)  # -> Geometry, Transform
yz_plane_6 = YZPlane(Origin=Point(0, 0, 0))
plane_offset_18 = PlaneOffset(BasePlane=yz_plane_6, Offset=division_2)
xy_plane_8 = XYPlane(Origin=Point(0, 0, 0))
plane_offset_19 = PlaneOffset(BasePlane=xy_plane_8, Offset=expr("-x", division))
project_8 = Project(Geometry=project_7.Geometry, Plane=plane_offset_18)  # -> Geometry, Transform
merge_6 = Merge(Data1=project_7.Geometry, Data2=project_8.Geometry)
project_9 = Project(Geometry=merge_6, Plane=plane_offset_19)  # -> Geometry, Transform
reverse_list_2 = ReverseList(List=project_9.Geometry)
number_slider_5 = Slider(1, range=0..2)
merge_7 = Merge(Data1=merge_6, Data2=reverse_list_2)
negative = Negative(Value=number_slider_5)
polyline_2 = PolyLine(Vertices=merge_7, Closed=True)
box_rectangle = BoxRectangle(Rectangle=[polyline_2, polyline], Height=number_slider_5)
box_rectangle_2 = BoxRectangle(Rectangle=[polyline_2, polyline], Height=negative)
solid_union_3 = SolidUnion(Breps=[box_rectangle, box_rectangle_2])
mirror_10 = Mirror(Geometry=solid_union_3, Plane=plane_origin)  # -> Geometry, Transform
mirror_11 = Mirror(Geometry=[solid_union_3, mirror_10.Geometry], Plane=plane_origin_2)  # -> Geometry, Transform
solid_union_4 = SolidUnion(Breps=[mirror_11.Geometry, solid_union_3, mirror_10.Geometry])

plane_offset_20 = PlaneOffset(BasePlane=plane_origin_3, Offset=expr("-x", division_8))
number_slider_6 = Slider(2, range=0..5)
project_10 = Project(Geometry=merge_2, Plane=plane_offset_20)  # -> Geometry, Transform
division_9 = Division(A=Slider(3.2, range=0..5), B=2)
xy_plane_9 = XYPlane(Origin=Point(0, 0, 0))
circle_cnr = CircleCNR(Center=project_10.Geometry, Normal=plane_offset_20, Radius=division_9)
plane_offset_21 = PlaneOffset(BasePlane=xy_plane_9, Offset=expr("-x", division))
plane_offset_22 = PlaneOffset(BasePlane=plane_offset_20, Offset=number_slider_6)
graft_tree = GraftTree(Tree=circle_cnr, IncludeEmptyLists=True, IncludeNullItems=True)
subtraction_6 = Subtraction(A=number_slider_2, B=Slider(0.2, range=0..1))
project_11 = Project(Geometry=graft_tree, Plane=plane_offset_21)  # -> Geometry, Transform
project_12 = Project(Geometry=merge_2, Plane=plane_offset_22)  # -> Geometry, Transform
loft_9 = Loft(
    Curves=[graft_tree, project_11.Geometry],
    Options={Adjust=False, Closed=False, LoftEnds=0, LoftSimp=0, LoftType=0, Rebuild=10, Refit=0.01})
cylinder_2 = Cylinder(Base=project_12.Geometry, Radius=subtraction_6, Length=expr("-x", number_slider_6))
flatten_tree_5 = FlattenTree(Tree=loft_9, Path="{0}")
cap_holes_10 = CapHoles(Brep=cylinder_2)
cap_holes_11 = CapHoles(Brep=flatten_tree_5)
solid_union_5 = SolidUnion(Breps=[cap_holes_11, cap_holes_10])

xy_plane_10 = XYPlane(Origin=Point(0, 0, 0))
addition_4 = Addition(A=division_8, B=Slider(0.2, range=0..1))
evaluate_box = EvaluateBox(Box=cap_holes_10, UParameter=0.5, VParameter=0.5, WParameter=0.5)  # -> Plane, Point, Include
plane_offset_23 = PlaneOffset(BasePlane=plane_origin_3, Offset=addition_4)
plane_offset_24 = PlaneOffset(BasePlane=xy_plane_10, Offset=division)
project_13 = Project(Geometry=graft_tree, Plane=plane_offset_24)  # -> Geometry, Transform
project_14 = Project(Geometry=graft_tree, Plane=plane_offset_23)  # -> Geometry, Transform
scale = Scale(Geometry=cap_holes_10, Center=evaluate_box.Point, Factor=Slider(1.2, range=0..10))  # -> Geometry, Transform
loft_10 = Loft(
    Curves=[project_14.Geometry, project_13.Geometry],
    Options={Adjust=False, Closed=False, LoftEnds=0, LoftSimp=0, LoftType=0, Rebuild=10, Refit=0.01})
flatten_tree_6 = FlattenTree(Tree=loft_10, Path="{0}")
cap_holes_12 = CapHoles(Brep=flatten_tree_6)
solid_difference_4 = SolidDifference(BrepsA=cap_holes_12, BrepsB=scale.Geometry)
multiplication = Multiplication(A=division, B=2)
box_rectangle_3 = BoxRectangle(Rectangle=rectangle_2pt_7.Rectangle, Height=multiplication)
solid_difference_5 = SolidDifference(BrepsA=solid_difference_4, BrepsB=box_rectangle_3)

subtraction_7 = Subtraction(A=division_7, B=Slider(6.6, range=0..10))
subtraction_8 = Subtraction(A=division_6, B=Slider(11.5, range=0..100))
vector_xyz_8 = VectorXYZ(XComponent=expr("-x", subtraction_8), YComponent=subtraction_7, ZComponent=0)  # -> Vector, Length
addition_5 = Addition(A=division_8, B=Slider(3, range=0..10))
move_7 = Move(Geometry=construct_point_5, Motion=vector_xyz_8.Vector)  # -> Geometry, Transform
plane_offset_25 = PlaneOffset(BasePlane=plane_origin_3, Offset=expr("-x", addition_5))
project_15 = Project(Geometry=move_7.Geometry, Plane=plane_offset_25)  # -> Geometry, Transform
move_8 = Move(Geometry=project_15.Geometry, Motion=vector_xyz_2.Vector)  # -> Geometry, Transform
move_9 = Move(Geometry=project_15.Geometry, Motion=vector_xyz.Vector)  # -> Geometry, Transform
plane_offset_26 = PlaneOffset(BasePlane=plane_offset_25, Offset=expr("-x", Slider(0.5, range=0..1)))
rectangle_2pt_12 = Rectangle2Pt(Plane=plane_offset_26, PointA=move_8.Geometry, PointB=move_9.Geometry, Radius=Slider(1, range=0..3))  # -> Rectangle, Length
project_16 = Project(Geometry=rectangle_2pt_12.Rectangle, Plane=plane_offset_11)  # -> Geometry, Transform
loft_11 = Loft(
    Curves=[rectangle_2pt_12.Rectangle, project_16.Geometry],
    Options={Adjust=False, Closed=False, LoftEnds=0, LoftSimp=0, LoftType=0, Rebuild=10, Refit=0.01})
cap_holes_13 = CapHoles(Brep=loft_11)

project_17 = Project(Geometry=rectangle_2pt_12.Rectangle, Plane=plane_offset_25)  # -> Geometry, Transform
plane_offset_27 = PlaneOffset(BasePlane=plane_offset_25, Offset=expr("-x", Slider(2, range=0..10)))
offset_4 = Offset(Curve=project_17.Geometry, Distance=expr("-x", Slider(1.3, range=0..2)), Plane=plane_offset_11, Corners=1)
offset_5 = Offset(Curve=project_17.Geometry, Distance=expr("-x", Slider(0.8, range=0..1)), Plane=plane_offset_25, Corners=1)
flatten_tree_7 = FlattenTree(Tree=offset_4, Path="{0}")
flatten_tree_8 = FlattenTree(Tree=offset_5, Path="{0}")
project_18 = Project(Geometry=flatten_tree_7, Plane=plane_offset_11)  # -> Geometry, Transform
project_19 = Project(Geometry=flatten_tree_8, Plane=plane_offset_27)  # -> Geometry, Transform
loft_12 = Loft(
    Curves=[flatten_tree_7, project_18.Geometry],
    Options={Adjust=False, Closed=False, LoftEnds=0, LoftSimp=0, LoftType=0, Rebuild=10, Refit=0.01})
loft_13 = Loft(
    Curves=[project_19.Geometry, flatten_tree_8],
    Options={Adjust=False, Closed=False, LoftEnds=0, LoftSimp=0, LoftType=0, Rebuild=10, Refit=0.01})
cap_holes_14 = CapHoles(Brep=loft_12)
cap_holes_15 = CapHoles(Brep=loft_13)
solid_union_6 = SolidUnion(Breps=[cap_holes_15, cap_holes_14])

# ---- group: Knob
number_slider_7 = Slider(0.1, range=0..1)
division_10 = Division(A=wall_thickness, B=Slider(10, range=0..10))
offset_6 = Offset(Curve=flatten_tree_7, Distance=expr("-x", number_slider_7), Plane=plane_offset_11, Corners=1)
offset_7 = Offset(Curve=flatten_tree_8, Distance=expr("-x", number_slider_7), Plane=plane_offset_25, Corners=1)
plane_offset_28 = PlaneOffset(BasePlane=plane_offset_11, Offset=division_10)
flatten_tree_9 = FlattenTree(Tree=offset_6, Path="{0}")
flatten_tree_10 = FlattenTree(Tree=offset_7, Path="{0}")
project_20 = Project(Geometry=flatten_tree_9, Plane=plane_offset_28)  # -> Geometry, Transform
project_21 = Project(Geometry=flatten_tree_10, Plane=plane_offset_27)  # -> Geometry, Transform
loft_14 = Loft(
    Curves=[flatten_tree_9, project_20.Geometry],
    Options={Adjust=False, Closed=False, LoftEnds=0, LoftSimp=0, LoftType=0, Rebuild=10, Refit=0.01})
loft_15 = Loft(
    Curves=[project_21.Geometry, flatten_tree_10],
    Options={Adjust=False, Closed=False, LoftEnds=0, LoftSimp=0, LoftType=0, Rebuild=10, Refit=0.01})
cap_holes_16 = CapHoles(Brep=loft_14)
cap_holes_17 = CapHoles(Brep=loft_15)
solid_union_7 = SolidUnion(Breps=[cap_holes_17, cap_holes_16])

# ----
solid_difference_6 = SolidDifference(BrepsA=cap_holes_13, BrepsB=solid_union_6)

solid_union_8 = SolidUnion(Breps=[solid_union_4, solid_union_5, solid_difference_6])
solid_union_9 = SolidUnion(Breps=[cap_holes_7, brep_join.Breps, solid_union_2, solid_union_6])
solid_difference_7 = SolidDifference(BrepsA=solid_union_9, BrepsB=solid_union_8)
solid_difference_8 = SolidDifference(BrepsA=solid_difference_7, BrepsB=cap_holes_5)
solid_difference_9 = SolidDifference(BrepsA=solid_difference_7, BrepsB=cap_holes_4)
solid_difference_10 = SolidDifference(BrepsA=solid_difference_8, BrepsB=solid_difference_4)
solid_difference_11 = SolidDifference(BrepsA=solid_difference_2, BrepsB=solid_difference_10)
solid_union_10 = SolidUnion(Breps=[solid_difference_11, solid_difference_5])
solid_difference_12 = SolidDifference(BrepsA=solid_difference, BrepsB=solid_difference_9)
